# Grasshopper definition bathroom.gh (Grasshopper 1.0.7)
# plug-ins: glTFexporter

imgsettings = ImageSettings(Saturation=Slider(0.5, range=0..1), Contrast=Slider(-0.5, range=-1..1), Lightness=Slider(0.52, range=-1..1))
path = FilePath("C:\Users\dee\Desktop\InStall\materials\marble_01_1k_jpg\marble_01_diff_1k.jpg")
imgsettings_2 = ImageSettings(Saturation=Slider(0.5, range=0..1), Contrast=Slider(-0.5, range=-1..1), Lightness=0)
texture = Texture(ImagePath=path, ImageSettings=imgsettings)
path_2 = FilePath("C:\Users\dee\Desktop\InStall\materials\marble_01_1k_jpg\marble_01_nor_1k.jpg")
path_3 = FilePath("C:\Users\dee\Desktop\InStall\materials\marble_01_1k_jpg\marble_01_rough_1k.jpg")
path_4 = FilePath("C:\Users\dee\Desktop\InStall\materials\floor_tiles_06_1k_jpg\floor_tiles_06_nor_1k.jpg")
path_5 = FilePath("C:\Users\dee\Desktop\InStall\materials\floor_tiles_06_1k_jpg\floor_tiles_06_rough_1k.jpg")
path_6 = FilePath("C:\Users\dee\Desktop\InStall\materials\floor_tiles_06_1k_jpg\floor_tiles_06_diff_1k.jpg")
texture_2 = Texture(ImagePath=path_2)
texture_3 = Texture(ImagePath=path_3)
texture_4 = Texture(ImagePath=path_4)
texture_5 = Texture(ImagePath=path_5)
texture_6 = Texture(ImagePath=path_6, ImageSettings=imgsettings_2)
meshstandardmaps = MeshStandardMaterialMaps(Map=texture, AlphaTest=0.5, BumpScale=1, DisplacementScale=1, NormalMap=texture_2, EnvMapIntensity=1, AoMapIntensity=1)
meshstandardmaps_2 = MeshStandardMaterialMaps(
    Map=texture_6,
    AlphaTest=0.5,
    BumpScale=1,
    DisplacementScale=1,
    NormalMap=texture_4,
    EnvMapIntensity=1,
    RoughnessMap=texture_5,
    AoMapIntensity=1)
swatch = ColourSwatch(SwatchColor=RGB(255, 255, 255))
brep = Brep([<brep referenced from the Rhino model> x7])
brep_2 = Brep([<brep referenced from the Rhino model> x2])
brep_3 = Brep([<brep referenced from the Rhino model> x2])
pt = Point([<point referenced from the Rhino model> x7])
standardmat = MeshStandardMaterial(Color=swatch, Opacity=1, Roughness=1, Metalness=0.5, Emissive=swatch, EmissiveIntensity=1)
brep_4 = Brep(<brep referenced from the Rhino model>)
brep_5 = Brep([<brep referenced from the Rhino model> x14])
mesh = Mesh([<mesh referenced from the Rhino model> x4])
pt_2 = Point(<point referenced from the Rhino model>)
standardmat_2 = MeshStandardMaterial(
    Color=ColourSwatch(SwatchColor=RGB(255, 255, 255)),
    Opacity=1,
    Roughness=Slider(0, range=0..1),
    Metalness=0.5,
    Emissive=RGB(0, 0, 0),
    EmissiveIntensity=1)
brep_6 = Brep(<brep referenced from the Rhino model>)
brep_7 = Brep([<brep referenced from the Rhino model> x2])
standardmat_3 = MeshStandardMaterial(
    Color=RGB(255, 255, 255),
    Opacity=1,
    Roughness=1,
    Metalness=0.5,
    Emissive=RGB(0, 0, 0),
    EmissiveIntensity=1,
    Maps=meshstandardmaps_2)
mesh_2 = Mesh(<mesh referenced from the Rhino model>)
standardmat_4 = MeshStandardMaterial(
    Color=ColourSwatch(SwatchColor=RGB(242, 242, 242)),
    Opacity=1,
    Roughness=Slider(0, range=0..1),
    Metalness=0.5,
    Emissive=RGB(0, 0, 0),
    EmissiveIntensity=1)
basicmat = MeshBasicMaterial(Color=ColourSwatch(SwatchColor=RGB(0, 0, 0)))
standardmat_5 = MeshStandardMaterial(
    Color=ColourSwatch(SwatchColor=RGB(252, 152, 141)),
    Opacity=1,
    Roughness=1,
    Metalness=0.5,
    Emissive=RGB(0, 0, 0),
    EmissiveIntensity=1)
mesh_3 = Mesh(<mesh referenced from the Rhino model>)
standardmat_6 = MeshStandardMaterial(
    Color=ColourSwatch(SwatchColor=RGB(207, 207, 207)),
    Opacity=1,
    Roughness=1,
    Metalness=0.5,
    Emissive=RGB(0, 0, 0),
    EmissiveIntensity=1)
standardmat_7 = MeshStandardMaterial(
    Color=ColourSwatch(SwatchColor=RGB(252, 152, 141)),
    Opacity=1,
    Roughness=1,
    Metalness=0.5,
    Emissive=RGB(0, 0, 0),
    EmissiveIntensity=1)
standardmat_8 = MeshStandardMaterial(
    Color=RGB(255, 255, 255),
    Opacity=1,
    Roughness=1,
    Metalness=0.5,
    Emissive=RGB(0, 0, 0),
    EmissiveIntensity=1,
    Maps=meshstandardmaps)
basicmat_2 = MeshBasicMaterial(Color=ColourSwatch(SwatchColor=RGB(255, 255, 255)))
dirlight = DirectionalLight(
    Position=pt_2,
    Color=RGB(255, 255, 255),
    Intensity=Slider(0.5, range=0..1),
    CastShadow=False,
    ShadowTop=10,
    ShadowBottom=-10,
    ShadowRight=10,
    ShadowLeft=-10,
    ShadowNear=0,
    ShadowFar=100)  # -> Helper, Light
mesh_4 = Mesh(Mesh=brep, Material=standardmat, DecimalAccuracy=3)
ptlight = PointLight(Position=pt, Color=RGB(255, 255, 255), Intensity=Slider(0.2, range=0..1), Distance=0, Decay=1, CastShadow=Toggle(False))  # -> Helper, Light
hemilight = HempisphereLight(Color=RGB(135, 206, 250), GroundColor=RGB(210, 180, 140), Intensity=0.5)
mesh_5 = Mesh(Mesh=brep_2, Material=basicmat, DecimalAccuracy=3)
mesh_6 = Mesh(Mesh=brep_4, Material=basicmat_2, DecimalAccuracy=3)
mesh_7 = Mesh(Mesh=mesh_3, Material=standardmat_8, DecimalAccuracy=3)
mesh_8 = Mesh(Mesh=mesh, Material=standardmat_2, DecimalAccuracy=3)
mesh_9 = Mesh(Mesh=mesh_2, Material=standardmat_3, DecimalAccuracy=3)
mesh_10 = Mesh(Mesh=brep_3, Material=standardmat_5, DecimalAccuracy=3)
mesh_11 = Mesh(Mesh=brep_6, Material=standardmat_6, DecimalAccuracy=3)
mesh_12 = Mesh(Mesh=brep_7, Material=standardmat_4, DecimalAccuracy=3)
mesh_13 = Mesh(Mesh=brep_5, Material=standardmat_7, DecimalAccuracy=3)
preview = CustomPreview(
    Geometry=dirlight.Helper,
    Material={diffuse=RGB(221, 160, 221), emission=RGB(66, 48, 66), shine=0.5, specular=RGB(255, 255, 255), transparency=0})
button = Button()
merge = Merge(Data1=hemilight, Data2=dirlight.Light, Data3=ptlight.Light, Data4=mesh_4)
merge_2 = Merge(
    Data1=mesh_6,
    Data2=mesh_7,
    Data3=mesh_11,
    Data4=mesh_10,
    Data5=mesh_13,
    Data6=mesh_9,
    Data7=mesh_8,
    Data8=mesh_12,
    Data9=mesh_5)
nickname = RelativePath()
split = TextSplit(Text=nickname, Separators="/")
split_2 = SplitList(List=split, Index=Slider(5, range=0..10))  # -> ListA, ListB
scene = CompileScene(Objects=[merge_2, merge], BackgroundColor=ColourSwatch(SwatchColor=RGB(255, 255, 255)))
join = TextJoin(Text=split_2.ListA, Join="/")
serialize = SerializeObject(Object3d=scene, Minify=False, Run=button)
concat = Concatenate(FragmentA=join, FragmentB="/www/")
concat_2 = Concatenate(FragmentA=join, FragmentB="/www/assets/")
http = HTTPServer(Path=concat, Run=Toggle(True))
writetxt = WriteTextFile(Path=concat_2, FileName="bathroom.json", Data=serialize, Write=button)
panel = Panel(join)
